# Grasshopper definition sample_cutting_automating.gh (Grasshopper 1.0.7)
# plug-ins: Robots

betterhwc = Mesh([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])
# Tool Setting
low_poly_hwc = Mesh(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)
mesh_join = MeshJoin(Meshes=betterhwc)
plane = Plane(Plane(origin=(0, 0, 0), x=(-0.8660254038, 0.5, 0), y=(0.5, 0.8660254038, 0)))
bounding_box = BoundingBox(Content=mesh_join, Plane=plane)  # -> Box, Box_2
boundary_volume = BoundaryVolume(Boundaries=bounding_box.Box)
volume = Volume(Geometry=boundary_volume)  # -> Volume, Centroid
point = Point(Point(21.01827353, 84.2551242, 1264.390603))
line = Line(Line((-1.19625009, 0.6900518966, 1264.390596), (-1.19625009, 0.6900518966, 764.3905964)))
line_pt = LinePt(Line=line, Point=point)
tool_name = Panel("wirecutter")
weight = Panel("45")
create_tool = CreateTool(Name=tool_name, TCP=line_pt, Weight=Slider(35, range=0..100), Centroid=volume.Centroid, Mesh=mesh_join)  # -> Tool, TCP

# ----
# Robot Setting
# 正下方tooling
# 收刀
# 前面
# 正下方
# 左侧刀，从上到下
# 上方tooling
# 右侧，下到上
# 斜下方
number_slider = Slider(-400, range=-500..500)
construct_point = ConstructPoint(XCoordinate=0, YCoordinate=number_slider, ZCoordinate=0)
value_list = ValueList({"AA-KR60", "AA-KR30", "AA-KR60_KR30", "AARCH IRB120", "AARCH IRB6620", "Bartlett-IRB120", "Bartlett-IRB1600", "Bartlett-KR6", "Bartlett-KR60", "Bartlett-UR10"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}, selected="Penn-IRB4600-60 + Track")
construct_plane = ConstructPlane(Origin=construct_point, XAxis=Vector(1, 0, 0), YAxis=Vector(0, 1, 0))
# “输入的是保留的数值
rotate = Rotate(Geometry=construct_plane, Angle=degrees(270), Plane=PlaneXY(0, 0, 0))  # -> Geometry, Transform
load_robot_system = LoadRobotSystem(Name=value_list, Base=rotate.Geometry)

# ----
# Original Status Setting
number_slider_2 = Slider(18, range=-360..360)
merge = Merge(
    Data1=Slider(-15, range=-360..360),
    Data2=Slider(0, range=-360..360),
    Data3=Slider(3, range=-360..360),
    Data4=Slider(-22, range=-360..360),
    Data5=number_slider_2,
    Data6=Slider(11, range=-360..360))
degrees_to_radians = DegreesToRadians(Degrees=merge, RobotSystem=load_robot_system, MechanicalGroup=0)
create_target = CreateTarget(
    Joints=degrees_to_radians,
    Tool=create_tool.Tool,
    Speed="20",
    Zone="20",
    External=Slider(1200, range=600..5500),
    IsCartesian=False)

# ----
# Right click in "Simulation" component and "open controls".
# You can simulate the robot program at diferent speeds.
# rotate the jig around its center on the
# welding table
# bring the wire to the base of the jig to correctly
# orient the physical jig to the simulated angle
# (enable each to use)
# set dynamic speed of the tool based on the
# how much the tool's orientation is changing
# for each point.
number_slider_3 = Slider(0, range=0..100)
surface = Surface([<surface referenced from the Rhino model> x6])
py_cutting_file_automating = GhPythonScript(srfs=surface)  # -> out, cloudcent, planes, pathpts; inputs srfs: list
# ---------- py_cutting_file_automating: Python ----------
__author__ = "Shawn Wang"
__version__ = "2021.10.17"

import rhinoscriptsyntax as rs

################# HERE SHOULD BE THE FOAM PIECE PLACING AUTOMATING ###############

################# HERE STARTS THE CUTTING FILE AUTOMATING ###############

#extract boundary crvs
tempsrfedges = []
for srf in srfs:
    edges = rs.DuplicateEdgeCurves(srf)
    tempsrfedges.append(edges)

#find rails
#need to figure out a way to colaborate curves' direction ====> using start and end points 
newsrfs = []    #[srfindex]
srfedges = []   #[srfindex, [boolean of modified, [[crv00, crv01], [crv10, crv11]...]]]
for i in range(len(srfs)):
    bool = False
    if rs.IsSurfacePlanar(srfs[i]):
        #the surface is planar
        #print"hi"
        srfedges.append([False, []])
        for j in range(len(tempsrfedges[i])):
            try:
                rs.ReverseCurve(tempsrfedges[i][j])
                testsrf = rs.AddLoftSrf([tempsrfedges[i][j], tempsrfedges[i][j-1]])[0]
                srfedges[i][1].append([tempsrfedges[i][j], tempsrfedges[i][j-1]])
            except:
                pass
        for n in range(len(srfedges[i][1])):
            if srfedges[i][0] != True:
                #find the plane in front or back side
                if int(rs.CurveStartPoint(srfedges[i][1][n][0])[1]) == int(rs.CurveEndPoint(srfedges[i][1][n][0])[1]):
                    if int(rs.CurveStartPoint(srfedges[i][1][n][1])[1]) == int(rs.CurveEndPoint(srfedges[i][1][n][1])[1]):
                        cent = rs.SurfaceAreaCentroid(srfs[i])[0]
                        uppt = [cent[0], cent[1], rs.BrepClosestPoint(srfs[i], [0,0,9999])[0][2]]
                        downpt = [cent[0], cent[1], rs.BrepClosestPoint(srfs[i], [0,0,-999])[0][2]]
                        leftpt = [rs.BrepClosestPoint(srfs[i], [-999,0,0])[0][0], cent[1], cent[2]]
                        rightpt = [rs.BrepClosestPoint(srfs[i], [9999,0,0])[0][0], cent[1], cent[2]]
                        linemid = rs.AddLine(uppt, downpt)
                        srfedges[i][1] = [[rs.CopyObject(linemid, rs.PointSubtract(leftpt, cent)), rs.CopyObject(linemid, rs.PointSubtract(rightpt, cent))]]
                        rs.ReverseCurve(srfedges[i][1][0][1])
                        rs.ScaleObject(srfedges[i][1][0][0], rs.CurveMidPoint(srfedges[i][1][0][0]), [1.2, 1.2, 1.2])
                        rs.ScaleObject(srfedges[i][1][0][1], rs.CurveMidPoint(srfedges[i][1][0][1]), [1.2, 1.2, 1.2])
                        srfedges[i][0] = True
                        print "modified"
                #need to figure out how to find the best path for the rest planar surfaces
    else:
        #the surface is not planar
        if len(tempsrfedges[i]) == 4: 
        #4 edges surface
            for j in range(len(tempsrfedges[i])):
                if bool == False:
                    try:
                        rs.ReverseCurve(tempsrfedges[i][j])
                        testsrf = rs.AddLoftSrf([tempsrfedges[i][j], tempsrfedges[i][j+2]])[0]
                        if int(rs.SurfaceArea(testsrf)[0]) == int(rs.SurfaceArea(srfs[i])[0]):
                            #print "ture"
                            newsrfs.append(testsrf)
                            srfedges.append([False, [[tempsrfedges[i][j], tempsrfedges[i][j+2]]]])
                            bool = True
                        rs.ReverseCurve(tempsrfedges[i][j])
                    except:
                        pass
        elif len(tempsrfedges[i]) == 3:
            #3 edges surface
            for j in range(len(tempsrfedges[i])):
                if bool == False:
                    try:
                        rs.ReverseCurve(tempsrfedges[i][j])
                        testsrf = rs.AddLoftSrf([tempsrfedges[i][j], tempsrfedges[i][j-1]])[0]
                        if int(rs.SurfaceArea(testsrf)[0]) == int(rs.SurfaceArea(srfs[i])[0]):
                            #print "ture"
                            newsrfs.append(testsrf)
                            srfedges.append([False, [[tempsrfedges[i][j], tempsrfedges[i][j-1]]]])
                            bool = True
                        rs.ReverseCurve(tempsrfedges[i][j])
                    except:
                        pass
    
if len(srfedges) != len(srfs):
    print "something wrong in finding edges, please check original surfaces"
    #sys.exit()

#generate the number of path points
pathpts = []   #[[[ptlist00], [ptlist01]],[[ptlist10], [ptlist11]]...]
for i in range(len(srfedges)):
    #pathpts.append([])
    if srfedges[i][0] == True:
        num0 = len(rs.CurveEditPoints(srfedges[i][1][0][0]))
        num1 = len(rs.CurveEditPoints(srfedges[i][1][0][1]))
    elif srfedges[i][0] == False:
        num0 = len(rs.CurveEditPoints(srfedges[i][1][0][0]))
        num1 = len(rs.CurveEditPoints(srfedges[i][1][0][1]))
    if num0 >= num1:
        num = num0 * 2
    else:
        num = num1 * 2
    print num
    rs.ReverseCurve(srfedges[i][1][0][1])
    pts = [rs.DivideCurve(srfedges[i][1][0][0], num), rs.DivideCurve(srfedges[i][1][0][1], num)]
    pathpts.append(pts)
if len(pathpts) != len(srfs):
    print "something wrong in finding pathpts, please check srfedges"
    #sys.exit()

#generate curves from center points
centpts = []
centptcloud = []
for i in range(len(pathpts)):
    centpts.append([])
    for j in range(len(pathpts[i][0])):
        centpt = rs.VectorScale(rs.PointAdd(pathpts[i][0][j], pathpts[i][1][j]), 0.5)
        centpts[i].append(centpt)
        centptcloud.append(centpt)

#find track position
temppt = [0,0,0]
for pt in centptcloud:
    temppt = rs.PointAdd(temppt, pt)
cloudcent = rs.PointScale(temppt, 1/len(centptcloud))
trackpos = int(cloudcent[0] - 1500)
robotO   = (trackpos + 800, 0, 1000)
print "track:", trackpos


#generate path planes
planes = []
for i in range(len(centpts)):
    planes.append([])
    for j in range(len(centpts[i])):
        tempvecY = rs.PointSubtract(pathpts[i][0][j], pathpts[i][1][j])
        tempvecX = rs.VectorCrossProduct(tempvecY, [0,0,-1])
        plane = rs.CreatePlane(centpts[i][j], tempvecX, tempvecY)
        planes[i].append(plane)
# ---------- end py_cutting_file_automating ----------
list_item = ListItem(List=py_cutting_file_automating.pathpts, Index=number_slider_3, Wrap=True)
number_slider_4 = Slider(0, range=0..100)
panel = Panel(py_cutting_file_automating.out)
point_2 = Point(py_cutting_file_automating.cloudcent)
list_item_2 = ListItem(Index=number_slider_4, Wrap=True)
list_item_3 = ListItem(Index=number_slider_4, Wrap=True)
ghpython_script = GhPythonScript(x=py_cutting_file_automating.pathpts)  # -> out, a; inputs x: list
# ---------- ghpython_script: Python ----------
__author__ = "Shawn Wang"
__version__ = "2021.10.17"

import rhinoscriptsyntax as rs
a = []
n = 4
for i in range(len(x[n])):
    #a.append(x[n][i])
    for j in range(len(x[n][i])):
        a.append(x[n][i][j])
# ---------- end ghpython_script ----------
ghpython_script_2 = GhPythonScript(x=py_cutting_file_automating.cloudcent)  # -> out, a; inputs x: list
# ---------- ghpython_script_2: Python ----------
__author__ = "Shawn Wang"
__version__ = "2021.10.17"

import rhinoscriptsyntax as rs
a = []
n = 4
for i in range(len(x[n])):
    a.append(x[n][i])
    #for j in range(len(x[n][i])):
        #a.append(x[n][i][j])
# ---------- end ghpython_script_2 ----------
point_3 = Point(ghpython_script_2.a)

tempdatalocation = Panel("E:\0-Penn\ARCH-801-Material Agencies\Week08\data.txt")
surface_2 = Surface(<surface referenced from the Rhino model>)
track_position = Slider(1800, range=0..10000)
tcp = Slider(-250, range=-1000..1000)
reset = Button()
iterationlimit = Slider(6000, range=0..10000)
adjustingrate = Slider(8, range=0..10)

# ----
# Hot Wire Cutting Automating (Demo)
# 
# University of Pennsylvania MSD-RAS
# ARCH-801 Material Agency
# 
# Autor: Yuxuan Wang (yuxuan_1909@163.com)   https://github.com/wyxshawn
# Team Member: Mingyang Yuan, Chenxiao Li, Zilong Han
# 
# Professor: Andrew Saunders
# Teaching Assistant: Mathew White, Riley Studebaker
# Program Advisor: Robert Stuart Smith
# 
# Use GH Plugin: Robot-Visose:  Design Computation Lab - UCL  https://github.com/visose/Robots.wiki.git
# 
# Commercial Prohibition
# Research purposes are welcome, please feel free to email me.
# File developed for AML Lab's track robot, calibration are needed to fit with other robots.
# 
# It's a self practice, will be updated by request.
# V1.0  Oct. 2021
# The surface you want to cut. (Current only support one surface)
# Track position (if no result, try moving robot to the other side)
# Tool Center Point. (Slide to move tcp along isocurve)
# Reset data. (Click before toolpath finding)
# Data Recorder. (Click the cross before toolpath finding)
# Data Dam. (Right click and select "always" to start, select "never" to pause)
# Iteration limits
# Adjusting rate. (rotating angle each time, recommand 10 for the first test.)
# Replace "E:\...Week08" with a folder location in your computer
# If no results, try:
# 1.rotate & move foam block to a "comfortable" position for robot;
# 2.move the track;
# 3.move tool center points
# 
# In limited situations, try prime numbers, like 7.
py_cutting_file_initiating = GhPythonScript(srfs=surface_2, tcp=tcp, reset=reset)  # -> out, cloudcent, trackpos, planes, pathpts; inputs srfs: list, DataRec: list
# ---------- py_cutting_file_initiating: Python ----------
__author__ = "Shawn Wang"
__version__ = "2021.10.17"

import rhinoscriptsyntax as rs


################# HERE STARTS THE CUTTING FILE AUTOMATING ###############

#extract boundary crvs
tempsrfedges = []
for srf in srfs:
    edges = rs.DuplicateEdgeCurves(srf)
    tempsrfedges.append(edges)

#find rails
#need to figure out a way to colaborate curves' direction ====> using start and end points 
newsrfs = []    #[srfindex]
srfedges = []   #[srfindex, [boolean of modified, [[crv00, crv01], [crv10, crv11]...]]]
for i in range(len(srfs)):
    bool = False
    if rs.IsSurfacePlanar(srfs[i]):
        #the surface is planar
        #print"hi"
        srfedges.append([False, []])
        for j in range(len(tempsrfedges[i])):
            try:
                rs.ReverseCurve(tempsrfedges[i][j])
                testsrf = rs.AddLoftSrf([tempsrfedges[i][j], tempsrfedges[i][j-1]])[0]
                srfedges[i][1].append([tempsrfedges[i][j], tempsrfedges[i][j-1]])
            except:
                pass
        for n in range(len(srfedges[i][1])):
            if srfedges[i][0] != True:
                #find the plane in front or back side
                if int(rs.CurveStartPoint(srfedges[i][1][n][0])[1]) == int(rs.CurveEndPoint(srfedges[i][1][n][0])[1]):
                    if int(rs.CurveStartPoint(srfedges[i][1][n][1])[1]) == int(rs.CurveEndPoint(srfedges[i][1][n][1])[1]):
                        cent = rs.SurfaceAreaCentroid(srfs[i])[0]
                        uppt = [cent[0], cent[1], rs.BrepClosestPoint(srfs[i], [0,0,9999])[0][2]]
                        downpt = [cent[0], cent[1], rs.BrepClosestPoint(srfs[i], [0,0,-999])[0][2]]
                        leftpt = [rs.BrepClosestPoint(srfs[i], [-999,0,0])[0][0], cent[1], cent[2]]
                        rightpt = [rs.BrepClosestPoint(srfs[i], [9999,0,0])[0][0], cent[1], cent[2]]
                        linemid = rs.AddLine(uppt, downpt)
                        srfedges[i][1] = [[rs.CopyObject(linemid, rs.PointSubtract(leftpt, cent)), rs.CopyObject(linemid, rs.PointSubtract(rightpt, cent))]]
                        rs.ReverseCurve(srfedges[i][1][0][1])
                        rs.ScaleObject(srfedges[i][1][0][0], rs.CurveMidPoint(srfedges[i][1][0][0]), [1.2, 1.2, 1.2])
                        rs.ScaleObject(srfedges[i][1][0][1], rs.CurveMidPoint(srfedges[i][1][0][1]), [1.2, 1.2, 1.2])
                        srfedges[i][0] = True
                        print "modified"
                #need to figure out how to find the best path for the rest planar surfaces
    else:
        #the surface is not planar
        if len(tempsrfedges[i]) == 4: 
        #4 edges surface
            for j in range(len(tempsrfedges[i])):
                if bool == False:
                    try:
                        rs.ReverseCurve(tempsrfedges[i][j])
                        testsrf = rs.AddLoftSrf([tempsrfedges[i][j], tempsrfedges[i][j+2]])[0]
                        if int(rs.SurfaceArea(testsrf)[0]) == int(rs.SurfaceArea(srfs[i])[0]):
                            #print "ture"
                            newsrfs.append(testsrf)
                            srfedges.append([False, [[tempsrfedges[i][j], tempsrfedges[i][j+2]]]])
                            bool = True
                        rs.ReverseCurve(tempsrfedges[i][j])
                    except:
                        pass
        elif len(tempsrfedges[i]) == 3:
            #3 edges surface
            for j in range(len(tempsrfedges[i])):
                if bool == False:
                    try:
                        rs.ReverseCurve(tempsrfedges[i][j])
                        testsrf = rs.AddLoftSrf([tempsrfedges[i][j], tempsrfedges[i][j-1]])[0]
                        if int(rs.SurfaceArea(testsrf)[0]) == int(rs.SurfaceArea(srfs[i])[0]):
                            #print "ture"
                            newsrfs.append(testsrf)
                            srfedges.append([False, [[tempsrfedges[i][j], tempsrfedges[i][j-1]]]])
                            bool = True
                        rs.ReverseCurve(tempsrfedges[i][j])
                    except:
                        pass
    
if len(srfedges) != len(srfs):
    print "something wrong in finding edges, please check original surfaces"
    #sys.exit()

#generate the number of path points
pathpts = []   #[[[ptlist00], [ptlist01]],[[ptlist10], [ptlist11]]...]
for i in range(len(srfedges)):
    #pathpts.append([])
    if srfedges[i][0] == True:
        num0 = len(rs.CurveEditPoints(srfedges[i][1][0][0]))
        num1 = len(rs.CurveEditPoints(srfedges[i][1][0][1]))
    elif srfedges[i][0] == False:
        num0 = len(rs.CurveEditPoints(srfedges[i][1][0][0]))
        num1 = len(rs.CurveEditPoints(srfedges[i][1][0][1]))
    if num0 >= num1:
        num = num0 
    else:
        num = num1 
    #print num
    rs.ReverseCurve(srfedges[i][1][0][1])
    pts = [rs.DivideCurve(srfedges[i][1][0][0], num), rs.DivideCurve(srfedges[i][1][0][1], num)]
    pathpts.append(pts)
if len(pathpts) != len(srfs):
    print "something wrong in finding pathpts, please check srfedges"
    #sys.exit()

#generate curves from center points
centpts = []
centptcloud = []
for i in range(len(pathpts)):
    centpts.append([])
    for j in range(len(pathpts[i][0])):
        centpt = rs.EvaluateCurve(rs.AddLine(pathpts[i][0][j], pathpts[i][1][j]), tcp)
        centpts[i].append(centpt)
        centptcloud.append(centpt)

#find track position
temppt = [0,0,0]
for pt in centptcloud:
    temppt = rs.PointAdd(temppt, pt)
cloudcent = rs.PointScale(temppt, 1/len(centptcloud))
trackpos = int(cloudcent[0] - 1500)
robotO   = (trackpos + 800, 0, 1000)
print "track:", trackpos


#generate path planes
planes = []
for i in range(len(centpts)):
    planes.append([])
    if pathpts[i][0][0][1] <= pathpts[i][1][0][1]:  #wire cutter's direction
        for j in range(len(centpts[i])):
            tempvecY = rs.PointSubtract(pathpts[i][0][j], pathpts[i][1][j])
            tempvecX = rs.VectorCrossProduct(tempvecY, [0,0,-1])
            plane = rs.CreatePlane(centpts[i][j], tempvecX, tempvecY)
            planes[i].append(plane)
    else:
            for j in range(len(centpts[i])):
                tempvecY = rs.PointSubtract(pathpts[i][1][j], pathpts[i][0][j])
                tempvecX = rs.VectorCrossProduct(tempvecY, [0,0,-1])
                plane = rs.CreatePlane(centpts[i][j], tempvecX, tempvecY)
                planes[i].append(plane)
# ---------- end py_cutting_file_initiating ----------
# rotate the jig around its center on the
# welding table
# bring the wire to the base of the jig to correctly
# orient the physical jig to the simulated angle
# (enable each to use)
# set dynamic speed of the tool based on the
# how much the tool's orientation is changing
# for each point.
path = FilePath(tempdatalocation)
file = ReadFile(File=path, PerLineParse=True)
value_list_2 = ValueList({"Joint", "Linear"}, selected="Linear")
start_angle = Slider(30, range=-360..360)
program_name = Panel("Track:3000")
program_name_2 = Panel("TrackRobot")

data_dam = DataDam(DataDataA=file, BufferDelay=2500000, BufferMode=0)

panel_2 = Panel(data_dam)
py_cutting_file_adjusting = GhPythonScript(planes=py_cutting_file_initiating.planes, IterationLimit=iterationlimit, AdjustingRate=adjustingrate, DataRec=data_dam)  # -> out, planes; inputs planes: list, DataRec: list
# ---------- py_cutting_file_adjusting: Python ----------
__author__ = "Shawn Wang"
__version__ = "2021.10.20"

import rhinoscriptsyntax as rs

#adjust plane's direction
#recursive data reading
#print data
if DataRec:
    if len(DataRec) <= IterationLimit and DataRec[-1] != "Finished!":
        if len(DataRec) == 1:
            index = 0
        else:
            index = int(DataRec[-1])
        print "index:",  index
        planes[0][index] = rs.RotatePlane(planes[0][index], AdjustingRate, planes[0][index].YAxis)
        print len(DataRec)
    if len(DataRec) >= 2:
        if int(DataRec[-1]) == int(DataRec[-2]) + 1:
            planes[0][index] = rs.RotatePlane(planes[0][index], 0, planes[0][index].YAxis)
# ---------- end py_cutting_file_adjusting ----------
panel_3 = Panel(py_cutting_file_adjusting.out)
py_display = GhPythonScript(x=py_cutting_file_adjusting.planes, y=panel_2)  # -> out, a; inputs x: list, y: list of Int32
# ---------- py_display: Python ----------
__author__ = "Shawn Wang"
__version__ = "2021.10.17"

import rhinoscriptsyntax as rs
a = x[0][y[-1]]
# ---------- end py_display ----------
ghpython_script_3 = GhPythonScript(x=py_cutting_file_adjusting.planes)  # -> out, a; inputs x: list
# ---------- ghpython_script_3: Python ----------
__author__ = "Shawn Wang"
__version__ = "2021.10.17"

import rhinoscriptsyntax as rs
a = x[0]
# ---------- end ghpython_script_3 ----------
plane_2 = Plane(ghpython_script_3.a)
deconstruct_plane = DeconstructPlane(Plane=plane_2)  # -> Origin, XAxis, YAxis, ZAxis
rotate_3d = Rotate3D(Geometry=plane_2, Angle=degrees(start_angle), Center=deconstruct_plane.Origin, Axis=deconstruct_plane.YAxis)  # -> Geometry, Transform
create_target_2 = CreateTarget(
    Plane=rotate_3d.Geometry,
    Motion=value_list_2,
    Tool=create_tool.Tool,
    Speed="3",
    Zone="6",
    External=track_position,
    IsCartesian=True)
merge_2 = Merge(Data1=create_target, Data2=create_target_2)  # -> flatten(Result)
# Don't be afraid if these two batteries are red
create_program = CreateProgram(Name=program_name_2, RobotSystem=load_robot_system, Targets1=merge_2, StepSize=1)  # -> Program, Code, Duration, Warnings, Errors
program_simulation = ProgramSimulation(Program=create_program.Program, Time=Slider(1, range=0..1), Normalized=True)  # -> SystemMeshes, JointRotations, Plane, Index, Time, Program, Errors
py_extract_error = GhPythonScript(x=create_program.Errors, y=create_program.Duration, path=tempdatalocation)  # -> out, flatten(i), remove; inputs x: list
# ---------- py_extract_error: Python ----------
__author__ = "Shawn Wang"
__version__ = "2021.10.20"

import rhinoscriptsyntax as rs
import os
remove = False

if x:
    print x[0]
    
    if x[0][0:6] == 'Errors':
        i = str(int(x[0][17:-12]) - 1)
elif y == 0:
    pass
else:
    i = "Finished!"
    remove = True
# ---------- end py_extract_error ----------
errors = Panel(create_program.Warnings)
errors_2 = Panel(create_program.Errors)

data_recorder = DataRecorder(flatten(py_extract_error.i), DataLimit=-10, RecordData=True)

py_writetxt = GhPythonScript(x=data_recorder, remove=py_extract_error.remove, file=tempdatalocation)  # -> out, a; inputs x: list
# ---------- py_writetxt: Python ----------
__author__ = "Shawn Wang"
__version__ = "2021.10.20"

import rhinoscriptsyntax as rs
import os

print x
while None in x:
    x.remove(None)
if remove == False:
    data = open(file, 'w')
    data.write('\n'.join(x))
    data.close()
else:
    os.remove(file)
# ---------- end py_writetxt ----------
panel_4 = Panel(py_writetxt.out)

# ----
# Enable to get the rapid code.
# Disable before path finding to same time
data = Data(create_program.Code)  # disabled

cluster = Cluster_2(T=data)
cluster_2 = Cluster(T=data)
declarations = Panel(cluster)
rapid_code = Panel(cluster_2)
# Rapid Code
cull_index = CullIndex(List=rapid_code, Indices=0, Wrap=True)
panel_5 = Panel("""    PROC rRun_HWC_name()
        ConfL\Off;
        ConfJ\off;
        VelSet 100, 500;
        AccSet 75,75;""")
replace_text = ReplaceText(Text=panel_5, Find="name", Replace="C_1012_1main", RecursiveReplace=False)
panel_6 = Panel("""        ConfL\On;
        ConfJ\on;
    ENDPROC""")
insert_items = InsertItems(List=cull_index, Item=replace_text, Indices=0, Wrap=True)
insert_items_2 = InsertItems(List=insert_items, Item=panel_6, Indices=-1, Wrap=True)
final_rapid_code_program = Panel(insert_items_2)

# ----
# Collision Detect (cables on the robot is not included currently)
number_slider_5 = Slider(9, range=0..100)
welding_table = Data([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])
split_list = SplitList(List=program_simulation.SystemMeshes, Index=number_slider_5)  # -> ListA, ListB
collision_one_many = CollisionOneMany(Collider=split_list.ListB, Obstacles=flatten([split_list.ListA, welding_table]))  # -> Collision, Index

# ==== cluster Cluster
T = ClusterInput()
tstat = TreeStatistics(Tree=T)  # -> Paths, Length, Count
item = ListItem(List=tstat.Paths, Index=1, Wrap=True)
panel = Panel("""-1
-2""")
branch = TreeBranch(Tree=T, Path=item, MaintainPaths=True)
cull_i = CullIndex(List=branch, Indices=panel, Wrap=True)
L = ClusterOutput(cull_i)

# ==== cluster Cluster_2
T = ClusterInput()
tstat = TreeStatistics(Tree=T)  # -> Paths, Length, Count
item = ListItem(List=tstat.Paths, Index=0, Wrap=True)
branch = TreeBranch(Tree=T, Path=item, MaintainPaths=True)
B = ClusterOutput(branch)
